% Requirement links of holdLogic_testfile.mldatx (R2024b)

item 1 verifies new_requirement_set.slreqx#1
item 1 verifies new_requirement_set.slreqx#5
item 1 verifies new_requirement_set.slreqx#4
item 2 verifies new_requirement_set.slreqx#1: Output holding on decreasing
item 2 verifies new_requirement_set.slreqx#5: Immediate update on increasing input
item 2 verifies new_requirement_set.slreqx#4: Hold release after timeout