# Requirement set new_requirement_set (R2024b)

## 1 [#1] Output holding on decreasing
The system shall hold the output signal at its previous value for 5 seconds when the input signal decreases

## 2 [#5] Immediate update on increasing input
The system shall immediately update the output signal to the input value when the input signal increases

## 3 [#4] Hold release after timeout
The system shall release the output holding and resume following the input signal once the 5-second holding duration has elapsed

## 4 [#2] Hold release after timeout
The system shall release the output holding and resume following the input signal once the 5-second holding duration has elapsed

## 5 [#3] Immediate update on increasing input
The system shall immediately update the output signal to the input value when the input signal increases